% Simulink data dictionary ModelDictionary.sldd

Sig = Simulink.Signal()

actualAngles = Simulink.Bus()
  actualAngle_LHFE: double
  actualAngle_LKFE: double
  actualAngle_RHFE: double
  actualAngle_RKFE: double

actualDynamics = Simulink.Bus()
  actualAngles: Bus: actualAngles
  actualVelocities: Bus: actualVelocities
  actualTorques: Bus: actualTorques

actualTorques = Simulink.Bus()
  actualTorque_LHFE: double
  actualTorque_LKFE: double
  actualTorque_RHFE: double
  actualTorque_RKFE: double

actualVelocities = Simulink.Bus()
  actualVelocity_LHFE: double
  actualVelocity_LKFE: double
  actualVelocity_RHFE: double
  actualVelocity_RKFE: double

calculatedAngles = Simulink.Bus()
  calculatedAngle_LHFE: double
  calculatedAngle_LKFE: double
  calculatedAngle_RHFE: double
  calculatedAngle_RKFE: double

calculatedDynamics = Simulink.Bus()
  calculatedAngles: Bus: calculatedAngles
  calculatedVelocities: Bus: calculatedVelocities
  calculatedTorques: Bus: calculatedTorques

calculatedTorques = Simulink.Bus()
  calculatedTorque_LHFE: double
  calculatedTorque_LKFE: double
  calculatedTorque_RHFE: double
  calculatedTorque_RKFE: double

calculatedVelocities = Simulink.Bus()
  calculatedVelocity_LHFE: double
  calculatedVelocity_LKFE: double
  calculatedVelocity_RHFE: double
  calculatedVelocity_RKFE: double

targetAngles = Simulink.Bus()
  targetAngle_LHFE: double
  targetAngle_LKFE: double
  targetAngle_RHFE: double
  targetAngle_RKFE: double

targetTorques = Simulink.Bus()
  targetTorque_LHFE: double
  targetTorque_LKFE: double
  targetTorque_RHFE: double
  targetTorque_RKFE: double

targetVelocities = Simulink.Bus()
  targetVelocity_LHFE: double
  targetVelocity_LKFE: double
  targetVelocity_RHFE: double
  targetVelocity_RKFE: double

maxTorques = Simulink.Bus()
  maxTorque_LHFE: double
  maxTorque_LKFE: double
  maxTorque_RHFE: double
  maxTorque_RKFE: double

inDataSOMANETs = Simulink.Bus()
  inSOMANET_LHFE: Bus: inSOMANET
  inSOMANET_LKFE: Bus: inSOMANET
  inSOMANET_RHFE: Bus: inSOMANET
  inSOMANET_RKFE: Bus: inSOMANET

toDataSOMANETs = Simulink.Bus()
  toSOMANET_LHFE: Bus: toSOMANET
  toSOMANET_LKFE: Bus: toSOMANET
  toSOMANET_RHFE: Bus: toSOMANET
  toSOMANET_RKFE: Bus: toSOMANET

targetDynamics = Simulink.Bus()
  targetDynamica_LHFE: Bus: targetDynamica
  targetDynamica_LKFE: Bus: targetDynamica
  targetDynamica_RHFE: Bus: targetDynamica
  targetDynamica_RKFE: Bus: targetDynamica

toPowerElectronics = Simulink.Bus()
  toPDB: Bus: toPDB

toGES = Simulink.Bus()
  a: double

inPowerElectronics = Simulink.Bus()
  statusPDB: Bus: statusPDB
  statusBMS: Bus: statusBMS

statusBMS = Simulink.Bus()
  stateBMS: double
  statusChargeBattery: double
  statusTemperatureBattery: double
  minVoltCell: double
  maxVoltCell: double

inGES = Simulink.Bus()
  statusTemperatureMotor_LHFE: double
  statusTemperatureMotor_LKFE: double
  statusTemperatureMotor_RHFE: double
  statusTemperatureMotor_RKFE: double

statusPhaseCurrents = Simulink.Bus()
  statusPhaseCurrentBC_LHFE: Bus: statusPhaseCurrentBC
  statusPhaseCurrentBC_LKFE: Bus: statusPhaseCurrentBC
  statusPhaseCurrentBC_RHFE: Bus: statusPhaseCurrentBC
  statusPhaseCurrentBC_RKFE: Bus: statusPhaseCurrentBC

inInputDevice = Simulink.Bus()
  desiredState: double
  error: double

configSOMANET = Simulink.Bus()
  angleOffset: double
  polePairs: double
  minPosLimit: double
  maxPosLimit: double
  maxSpeed: double
  maxTorque: double
  positionKp: double
  positionKi: double
  positionKd: double
  positionIntegralLimit: double
  velocityKp: double
  velocityKi: double
  velocityKd: double
  velocityIntegralLimit: double
  breakReleaseStrategy: double

configSOMANETs = Simulink.Bus()
  configSOMANET_LHFE: Bus: configSOMANET
  configSOMANET_LKFE: Bus: configSOMANET
  configSOMANET_RHFE: Bus: configSOMANET
  configSOMANET_RKFE: Bus: configSOMANET

data = Simulink.Bus()
  inDataSOMANETs: Bus: inDataSOMANETs
  inInputDevice: Bus: inInputDevice
  inGES: Bus: inGES
  inPowerElectronics: Bus: inPowerElectronics
  toDataSOMANETs: Bus: toDataSOMANETs
  toInputDevice: Bus: toInputDevice
  toPowerElectronics: Bus: toPowerElectronics
  toGES: Bus: toGES
  error: Bus: error
  gaitPhase: double
  actualStateMARCH: double
  configSOMANETs: Bus: configSOMANETs
  calculatedDynamics: Bus: calculatedDynamics

error = Simulink.Bus()
  errorSOMANETs: Bus: errorSOMANETs
  errorInputDevice: double
  errorGES: Bus: errorGES
  errorPowerElectronics: Bus: errorPowerElectronics

errorGES = Simulink.Bus()
  errorGES1: double
  errorGES2: double

errorPowerElectronics = Simulink.Bus()
  errorPDB: double
  errorBMS: double

statusPDB = Simulink.Bus()
  statePDB: double
  statusCurrentBattery: double
  statusVoltageBattery: double
  statusTemperatureDCDC: double

toInputDevice = Simulink.Bus()
  actualStateMARCH: double
  error: double

toPDB = Simulink.Bus()
  masterOP: double

inSOMANET = Simulink.Bus()
  statusword: uint16
  actualAngle: int32
  actualVelocity: int32
  actualTorque: int16
  userMISO: uint32
  tuningStatus: uint32
  errorSOMANET: uint16
  statusPhaseCurrentB: int16
  statusPhaseCurrentC: int16
  opMode: int8
  statusTemperature: int16
  timestamp: uint32

toSOMANET = Simulink.Bus()
  controlword: uint16
  opMode: int8
  targetAngle: int32
  targetVelocity: int32
  targetTorque: int16
  tuningCommand: uint32
  userMOSI: uint32
  maxTorque: double

targetDynamica = Simulink.Bus()
  targetAngle: int32
  targetVelocity: int32
  targetTorque: int16

actualDynamica = Simulink.Bus()
  actualAngle: int32
  actualVelocity: int32
  actualTorque: int16

testVector = Simulink.Bus()
  statusword: uint16
  controlword: uint16
  desiredOpMode: int8
  errorSOMANET: uint16
  state: Enum: State

statusPhaseCurrentBC = Simulink.Bus()
  statusPhaseCurrentB: int16
  statusPhaseCurrentC: int16

errorSOMANETs = Simulink.Bus()
  errorSOMANET_LHFE: uint16
  errorSOMANET_LKFE: uint16
  errorSOMANET_RHFE: uint16
  errorSOMANET_RKFE: uint16